test file "PID_Tests_Motor"
  coverage: Decision, MCDC, SignalRange, SimulinkDesignVerifier, RelationalBoundary, Condition, LookupTable

suite "PID_Tests_Motor/PID_Init"

  case "PID_Tests_Motor_Harness1" [baseline]
    description: Test generated for the component 'PID_Tests_Motor/PID_Init'.
    model PID_Tests_Motor, harness PID_Tests_Motor_Harness1 (for PID_Tests_Motor/PID_Init)

suite "PID_Tests_Motor/PID_Update"

  case "PID_Tests_Motor_Harness2" [baseline]
    description: Test generated for the component 'PID_Tests_Motor/PID_Update'.
    model PID_Tests_Motor, harness PID_Tests_Motor_Harness2 (for PID_Tests_Motor/PID_Update)