% Simulink data dictionary PID_Tests_Motor.sldd

pid_handle_t = Simulink.Bus(DataScope="Imported", HeaderFile="Motor_PID.h")
  Kp: single
  Ki: single
  Kd: single
  integrator: single
  prevError: single
  outputMin: single
  outputMax: single
  integratorMin: single
  integratorMax: single
  tau: single
  dTermFilt: single
  dt: single